# Grasshopper definition test_slider_python.ghx (Grasshopper 0.9.76)
# Minimal test

testpy = TestPython(x=Slider(5, range=0..10))  # -> port
# ---------- testpy: Python ----------
a = x
# ---------- end testpy ----------
